# Dynamo graph 01_HelloWorld.dyn (Dynamo 1.3.3.4651)

# group: Create a simple action
code_block = CodeBlock { "Hello World!"; }
message = MachinaDynamo.Actions.Message(code_block)

# group: Use Machina to export a Program with that action
code_block_2 = CodeBlock { "MyFirstRobot"; "ABB"; }
robotCreate = MachinaDynamo.Robots.RobotCreate(code_block_2.out0, code_block_2.out1)
compileProgram = MachinaDynamo.Programs.CompileProgram(robotCreate, message)
watch = Watch(compileProgram)
