# Dynamo graph 02_SimpleProgram_VerticalLine.dyn (Dynamo 1.3.3.4651)

# group: Start message ;)
code_block = CodeBlock { "Let's do some robots!"; }
message = MachinaDynamo.Actions.Message(code_block)

# group: Set speed value
number_slider = DoubleSlider(100, range=0..100 step 0.1)
speedTo = MachinaDynamo.Actions.SpeedTo(number_slider)

# group: Move to Point
number_slider_2 = DoubleSlider(300, range=0..500 step 0.1)
number_slider_3 = DoubleSlider(200, range=0..500 step 0.1)
number_slider_4 = DoubleSlider(300, range=0..500 step 0.1)
byCoordinates = Point.ByCoordinates(x=number_slider_2, y=number_slider_3, z=number_slider_4)
XAxis = Vector.XAxis()
reverse = Vector.Reverse(XAxis)
YAxis = Vector.YAxis()
byOriginXAxisYAxis = Plane.ByOriginXAxisYAxis(byCoordinates, reverse, YAxis)
transformTo = MachinaDynamo.Actions.TransformTo(byOriginXAxisYAxis)

# group: Rotate around Y axis
YAxis_2 = Vector.YAxis()
number_slider_5 = DoubleSlider(-90, range=-180..180 step 0.1)
rotate = MachinaDynamo.Actions.Rotate(YAxis_2, number_slider_5)

# group: Slow down
number_slider_6 = DoubleSlider(-50, range=-50..50 step 0.1)
speed = MachinaDynamo.Actions.Speed(number_slider_6)

# group: Move along vector relative to where Robot is right now
number_slider_7 = DoubleSlider(0, range=0..500 step 0.1)
number_slider_8 = DoubleSlider(0, range=0..500 step 0.1)
number_slider_9 = DoubleSlider(250, range=0..500 step 0.1)
byCoordinates_2 = Vector.ByCoordinates(x=number_slider_7, y=number_slider_8, z=number_slider_9)
move = MachinaDynamo.Actions.Move(byCoordinates_2)

# group: Wait a bit before continuing
number_slider_10 = DoubleSlider(2500, range=0..5000 step 0.1)
wait = MachinaDynamo.Actions.Wait(number_slider_10)

# group: Fast again
number_slider_11 = DoubleSlider(200, range=0..200 step 0.1)
speedTo_2 = MachinaDynamo.Actions.SpeedTo(number_slider_11)

# group: Back to 'home' position
code_block_2 = CodeBlock { 0; 90; }
axesTo = MachinaDynamo.Actions.AxesTo(code_block_2.out0, code_block_2.out0, code_block_2.out0, code_block_2.out0, code_block_2.out1, code_block_2.out0)

# group: Merge actions into a list and display them
join = List.Join(message, speedTo, transformTo, rotate, speed, move, wait, speedTo_2, axesTo)
watch = Watch(join)

# group: Generate device-specific code
code_block_3 = CodeBlock { "MachinaRobot"; "ABB"; }
robotCreate = MachinaDynamo.Robots.RobotCreate(code_block_3.out0, code_block_3.out1)
boolean = BoolSelector(true)
boolean_2 = BoolSelector(true)
compileProgram = MachinaDynamo.Programs.CompileProgram(robotCreate, watch, boolean, boolean_2)
watch_2 = Watch(compileProgram)

# group: Write code to file
code_block_4 = CodeBlock { "02_SimpleProgram.prg"; }
writeText = File.WriteText(code_block_4, compileProgram)
