# Dynamo graph 04_SimpleToolPath.dyn (Dynamo 1.3.3.4651)

# group: Get curves from a DWG file
file_path = Filename(".\04_SimpleToolPath.dwg")
fromPath = Dynamo.Translation.FileLoader.FromPath(file_path)
getImportedObjects = Dynamo.Translation.FileLoader.GetImportedObjects(fromPath)
convertToGeometries = Dynamo.Translation.ImportedObject.ConvertToGeometries(getImportedObjects)
code_block = CodeBlock { 0; }
getItemAtIndex = List.GetItemAtIndex(list=convertToGeometries, index=code_block)

# group: Discretize curve into planes
number_slider = DoubleSlider(100, range=0..100 step 0.1)
pointsAtEqualSegmentLength = Curve.PointsAtEqualSegmentLength(curve=getItemAtIndex, divisions=number_slider)
# note: We flip the Planes to make it easier for the Robot to reach this orientation.
ZAxis = Vector.ZAxis()
reverse = Vector.Reverse(ZAxis)
startPoint = Curve.StartPoint(getItemAtIndex)
endPoint = Curve.EndPoint(getItemAtIndex)
create = List.Create(startPoint, pointsAtEqualSegmentLength, endPoint)
flatten = Flatten(create)
parameterAtPoint = Curve.ParameterAtPoint(curve=getItemAtIndex, point=flatten)
tangentAtParameter = Curve.TangentAtParameter(getItemAtIndex, parameterAtPoint)
byOriginNormalXAxis = Plane.ByOriginNormalXAxis(origin=pointsAtEqualSegmentLength, normal=reverse, xAxis=tangentAtParameter)

# group: Create individual actions
code_block_2 = CodeBlock { 100; }
speedTo = MachinaDynamo.Actions.SpeedTo(code_block_2)
code_block_3 = CodeBlock { 2; }
precisionTo = MachinaDynamo.Actions.PrecisionTo(code_block_3)
transformTo = MachinaDynamo.Actions.TransformTo(byOriginNormalXAxis)
code_block_4 = CodeBlock { 0; 0; 0; 0; 90; 0; }
axesTo = MachinaDynamo.Actions.AxesTo(code_block_4.out0, code_block_4.out1, code_block_4.out2, code_block_4.out3, code_block_4.out4, code_block_4.out5)

# group: Concatenate all Actions into a Program
create_2 = List.Create(speedTo, precisionTo, transformTo, axesTo)
flatten_2 = Flatten(create_2)

# group: Generate native code
code_block_5 = CodeBlock { "toolpather"; "ABB"; }
robotCreate = MachinaDynamo.Robots.RobotCreate(code_block_5.out0, code_block_5.out1)
boolean = BoolSelector(true)
boolean_2 = BoolSelector(true)
compileProgram = MachinaDynamo.Programs.CompileProgram(robotCreate, flatten_2, boolean, boolean_2)

# group: Export it to a file
file_path_2 = Filename(".\04_SimpleToolPath.prg")
writeText = File.WriteText(file_path_2, compileProgram)
